# Grasshopper definition Roundvaseexample.gh (Grasshopper 1.0.7)
# plug-ins: Bifocals, Pufferfish, Wombat, LunchBox, Silkworm

# ----
# Printer Settings
# Movement
# Extrusion
# Bed Size(Visual Only)
# Print Place (X,Y)
nozzle_size = Slider(0.6, range=0..1)
layer_height = Slider(0.4, range=0..1)
print_speed = Slider(30, range=0..100)
travel = Slider(150, range=0..200)
z_hop_1mm_default = BooleanToggle(False)
z_hop_height = Slider(2, range=0.1..10)
X = Slider(110, range=0..500)
filament_diameter = Slider(1.75, range=0..10)
retraction_length = Slider(2, range=0..10)
retract_speed = Slider(40, range=0..100)
prime_legth = Slider(1.1, range=0..10)
prime_speed = Slider(43, range=0..100)
Y = Slider(220, range=0..500)
Y_2 = Slider(110, range=0..500)
X_2 = Slider(220, range=0..500)
coordenada_x = Number(X)
coordenada_y = Number(Y_2)
rectangle = Rectangle(Plane=PlaneXY(0, 0, 0), XSize=X_2, YSize=Y, Radius=0)  # -> Rectangle, Length
construct_point = ConstructPoint(XCoordinate=coordenada_x, YCoordinate=coordenada_y, ZCoordinate=0)
surface = Surface(rectangle.Rectangle)
filament_diameter_2 = Number(filament_diameter)
unit_z = UnitZ(Factor="-5")
extrude = Extrude(Base=surface, Direction=unit_z)
retract_speed_2 = Number(retract_speed)
layer_height_2 = Number(layer_height)
z_hop_height_2 = Number(z_hop_height)
prime_speed_2 = Number(prime_speed)
prime_legth_2 = Number(prime_legth)
nozzle_size_2 = Number(nozzle_size)
print_speed_2 = Number(print_speed)
travel_2 = Number(travel)
retract = Number(retraction_length)
boolean = Boolean(z_hop_1mm_default)
custom_preview = CustomPreview(Geometry=extrude, Material="#B7B7B7")

# ----
# Geometry Generation Modules
# Circle Example
diametro = Slider(74, range=0..200)
point = Point(construct_point)
circle = Circle(Plane=point, Radius=diametro)

# ----
# Retangule Example
tamanho_do_retangulo = Slider(100, range=0..100)
point_2 = Point(construct_point)
xy_plane = XYPlane(Origin=Point(0, 0, 0))
rectangle_2 = Rectangle(Plane=point_2, XSize=tamanho_do_retangulo, YSize=tamanho_do_retangulo, Radius=0)  # -> Rectangle, Length

# ----
# Hexagon Example
point_3 = Point(construct_point)
diametro_2 = Slider(33, range=0..200)
lados_do_polígono = Slider(6, range=0..10)
raio_do_canto = Slider(7, range=0..10)
polygon = Polygon(Plane=point_3, Radius=diametro_2, Segments=lados_do_polígono, FilletRadius=raio_do_canto)  # -> Polygon, Length

# ----
# Configuration
quantity_of_repetitions = Slider(200, range=0..200)
walls_inside_true_outside_false = BooleanToggle(True)
vertical_spacing_layer_height = Slider(0.6, range=0..10)
rotation_angle = Slider(1, range=0..360)
walls_quantity = Slider(1, range=0..10)
walls_spacing = Slider(1, range=0..2)

# ----
# Put your curve here
curve = Curve(rectangle_2.Rectangle)

# ----
# Vertical curve deformation module
# Put your curve here
curve_2 = Curve(circle)

# ----
# Base Curve
curve_3 = Curve(rectangle_2.Rectangle)

# ----
# Base Curve
curve_4 = Curve(circle)

# ----
# Bottom
# Surface/Curve
boundary_surfaces = BoundarySurfaces(Edges=curve_4)

# ----
# Base Curve
curve_5 = Curve(polygon.Polygon)

# ----
# Set your layer height
# Make test with bigger layers
# for faster processing
layer_height_3 = Slider(0.3, range=0..50)

# ----
# Set your layer height
# Make test with bigger layers
# for faster processing
layer_height_4 = Slider(1, range=0..50)

# ----
# Walls Configuration
toggle_between_offset_methods = BooleanToggle(False)
inside_wals_or_outside = BooleanToggle(True)
# Wall and Infill Modules
wall_count = Slider(2, range=1..5)
offset_kinks = Slider(0, range=0..10)
offset_cap_type = Slider(0, range=0..10)

# ----
# Infill Configuration
infill_rotation = Slider(0, range=0..180)
infill_density = Slider(75, range=0..100)

# ----
# Gcode angle precision
tolerance = Slider(3, range=1..50)

show_gcode_preview = BooleanToggle(True)
final_layer = Slider(1, range=0..1)
show_travels = BooleanToggle(True)
inicial_layer = Slider(0, range=0..1)

# ----
# Put your
# START GCODE
# here:
start_gcode = Panel("""G21 ; metric values
G90 ; absolute positioning
M83 ; set extruder to absolute mode
M107 ; start with the fan off
G92 E0 ; Reset Extruder
G28 ; Home all axes
M140 S60 ; set bed temperature
M190 S60 ; wait for temperature to be reached
M104 S200 ; set temperature
M109 S200 ; wait for temperature to be reached
G1 Z2.0 F3000 ; Move Z Axis up little to prevent scratching of Heat Bed
G1 X0.1 Y20 Z0.3 F5000.0 ; Move to start position
G1 X0.1 Y200.0 Z0.3 F1500.0 E15 ; Draw the first line
G1 X0.4 Y200.0 Z0.3 F5000.0 ; Move to side a little
G1 X0.4 Y20 Z0.3 F1500.0 E30 ; Draw the second line
G92 E0 ; Reset Extruder
G1 Z2.0 F3000 ; Move Z Axis up little to prevent scratching of Heat Bed
G1 X5 Y20 Z0.3 F5000.0 ; Move over to prevent blob squish
G28 ; home all axes
M83 ; use absolute distances for extrusion
G90 ; use absolute coordinates
G21 ; set units to millimeters
G92 E0 ; reset extrusion distance""")

# ----
# Put your
# FINAL GCODE
# here:
end_gcode = Panel("""M104 S0 ;extruder heater off
M140 S0 ;heated bed heater off
G91 ;relative positioning
G1 E-1 F300  ;retract the filament a bit before lifting the nozzle, to release some of the pressure
G1 Z+0.5 E-5 X-20 Y-20 F9000 ;move Z up a bit and retract filament even more
G90 ;absolute positioning
G1 X0 Y220 F3600 ;move extruder out of the way by moving the baseplate to the front for easier access to printed object
M84 ;steppers off""")

# ----
# Click here to export
export_your_gcode = Button()

# ---- group: File Path
# Select the file path(right mouse
# button + select directory)
# and put .gcode on the
# file name below
file_name = Panel("filename.gcode")
path = FilePath("C:\Users\raphi\OneDrive\Área de Trabalho\")

# ----
travel_speed = Number(travel_2)
filament_diameter_3 = Number(filament_diameter)
prime_legth_3 = Number(prime_legth_2)
retract_speed_3 = Number(retract_speed_2)
z_hop_height_3 = Number(z_hop_height_2)
layer_height_5 = Number(layer_height)
print_speed_3 = Number(print_speed)
nozzle_size_3 = Number(nozzle_size)
negative = Negative(Value=retract)
boolean_2 = Boolean(boolean)
prime_speed_3 = Number(prime_speed_2)
multiplication = Multiplication(A=print_speed_3, B="60")
multiplication_2 = Multiplication(A=prime_speed_3, B="60")
multiplication_3 = Multiplication(A="60", B=travel_speed)

multiplication_4 = Multiplication(A=retract_speed_3, B="60")

# ----
# Plugin panel integration
# you probably dont need to
# change anything here
panel = Panel("0")
construct_point_2 = ConstructPoint(XCoordinate=panel, YCoordinate=panel, ZCoordinate=z_hop_height_3)
panel_2 = Panel(construct_point_2)
flow = Flow(NozzleWidth=nozzle_size_3, LayerHeight=layer_height_5, FilamentDiameter=filament_diameter_3, Multiplier=1)

stream_filter = StreamFilter(Gate=boolean_2, Stream0="0,0,0", Stream1=panel_2)

silkworm_movement_delimiter = SilkwormMovementDelimiter(
    DelimitingStartVectors=stream_filter,
    StartVectorDelimitingSpeed=multiplication_2,
    StartVectorDelimitingPressure=prime_legth_3,
    DelimitingEndVectors=stream_filter,
    EndVectorDelimitingSpeed=multiplication_4,
    EndVectoreDelimitingPressure=negative,
    TravelSpeed=multiplication_3)

# ----
# Configuration
# Deformation Graph
curve_division = Slider(55, range=0..100)
amplitude = Slider(7.53, range=0..20)

# ----
# Configuration
# Deformation Graph
curve_division_2 = Slider(24, range=0..100)
amplitude_2 = Slider(15, range=0..20)

divide_curve = DivideCurve(Curve=curve, Count=curve_division, Kinks=False)  # -> Points, Tangents, Parameters
bounding_box = BoundingBox(Content=curve, Plane=PlaneXY(0, 0, 0))  # -> Box, Box_2
volume = Volume(Geometry=bounding_box.Box)  # -> Volume, Centroid

graph_mapper = GraphMapper(divide_curve.Points, x0=0, x1=1, y0=0, y1=1, container_name="Sine", Equation_px=[0, 1], Equation_py=[0, 1])

divide_curve_2 = DivideCurve(Curve=curve_2, Count=curve_division_2, Kinks=False)  # -> Points, Tangents, Parameters

graph_mapper_2 = GraphMapper(divide_curve_2.Points, x0=0, x1=1, y0=0, y1=1, container_name="Sine", Equation_px=[0, 1], Equation_py=[0, 1])

multiplication_5 = Multiplication(A=graph_mapper_2, B=amplitude_2)
unit_z_2 = UnitZ(Factor=multiplication_5)
move = Move(Geometry=divide_curve_2.Points, Motion=unit_z_2)  # -> Geometry, Transform
nurbs_curve = NurbsCurve(Vertices=move.Geometry, Degree=3, Periodic=True)  # -> Curve, Length, Domain

# ----
# Top Curve
curve_6 = Curve(nurbs_curve.Curve)

# ----
# Top Surface/Curve
curve_7 = Curve(curve_6)

number_slider = Slider(50, range=0..100)
# Loft Module
patch_surface = PatchSurface(EdgeCurves=curve_7, U=number_slider, V=number_slider, Tolerance=Slider(1, range=0..1))
loft_options = LoftOptions(Closed=False, Adjust=Toggle(True), Rebuild=0, Refit=0, Type=Slider(1, range=0..5))
loft = Loft(Curves=flatten([boundary_surfaces, patch_surface]), Options=loft_options)
brep_join = BrepJoin(Breps=flatten([loft, boundary_surfaces, patch_surface]))  # -> Breps, Closed

# ----
# 3D Model/Brep
brep = Brep(brep_join.Breps)

scale = Scale(Geometry=brep, Center=point, Factor=Slider(0.5, range=0..1))  # -> Geometry, Transform

# ----
# Modelo 3D
# Inserir modelo 3D aqui
brep_2 = Brep(scale.Geometry)

# ----
# 3D Slicing Modules
# Put your 3D model here
brep_3 = Brep(brep_2)

# ----
# Put your 3D model here
modelo_3d = Brep(brep_2)

# ----
# Select your top and bottom surface
number_slider_2 = Slider(5, range=0..20)
deconstruct_brep = DeconstructBrep(Brep=brep_3)  # -> Faces, Edges, Vertices
list_item = ListItem(List=deconstruct_brep.Faces, Index=Slider(4, range=0..20), Wrap=True)
list_item_2 = ListItem(List=deconstruct_brep.Faces, Index=number_slider_2, Wrap=True)

unit_z_3 = UnitZ(Factor=1)
contour = Contour(Shape=modelo_3d, Point=Point(0, 0, 0), Direction=unit_z_3, Distance=layer_height_4)

# ----
# Planar Layers Generation Module
# Slicing in Z direction the 3D model
boundary_surfaces_2 = BoundarySurfaces(Edges=contour)  # -> flatten(Surfaces)

# ----
# Top surface
base = Surface(list_item_2)

# ----
# Bottom Surface
base_2 = Surface(list_item)

curve_8 = Curve(base_2)
# Layer steps generation
curve_9 = Curve(base)
midpoint = Midpoint(Curve=curve_8)
# Non Planar Layer Generation Module
midpoint_2 = Midpoint(Curve=curve_9)
distance = Distance(PointA=midpoint_2, PointB=midpoint)
division = Division(A=distance, B=layer_height_3)
series = Series(Start=0, Step=layer_height_3, Count=division)
bounds = Bounds(Numbers=series)
remap_numbers = RemapNumbers(Value=series, Source=bounds, Target=Slider(1, range=0..1))  # -> Mapped, Clipped
tween_two_surfaces = TweenTwoSurfaces(SurfaceA=base_2, SurfaceB=base, Factor=remap_numbers.Mapped, Refit=0, PointSample=0)

# ----
# Planar layers
# on printing order
base_3 = Surface(boundary_surfaces_2)

coordenada_x_2 = Number(X)
coordenada_y_2 = Number(Y_2)
# Triming layers with 3d modell
unit_z_4 = UnitZ(Factor=Slider(1.22, range=0..10))
construct_point_3 = ConstructPoint(XCoordinate=coordenada_x_2, YCoordinate=coordenada_y_2, ZCoordinate="1")
scale_nu = ScaleNU(Geometry=brep_3, Plane=construct_point_3, ScaleX=1, ScaleY=1, ScaleZ=unit_z_4)  # -> Geometry, Transform
brep_join_2 = BrepJoin(Breps=tween_two_surfaces)  # -> Breps, Closed
split_brep = SplitBrep(Brep=brep_join_2.Breps, Cutter=scale_nu.Geometry)
list_item_3 = ListItem(List=split_brep, Index=Slider(1, range=0..10), Wrap=True)  # -> flatten(Item), Item1

# ----
# Non planar layers
# on printing order
base_4 = Surface(list_item_3.Item)

# ----
# Put your surface
# layers here
surface_2 = Surface(base_4)

nozzle_size_4 = Number(nozzle_size)
curve_10 = Curve(surface_2)
# Generation of wall offset curves
series_2 = Series(Start="0", Step=nozzle_size_4, Count=wall_count)
negative_2 = Negative(Value=series_2)
# Wall Generation Module
stream_filter_2 = StreamFilter(Gate=inside_wals_or_outside, Stream0=series_2, Stream1=negative_2)
offset_curve = OffsetCurve(
    Curve=graft(curve_10),
    Plane=PlaneXY(0, 0, 0),
    Distance=stream_filter_2,
    BothSides=0,
    Kinks=offset_kinks,
    CapType=offset_cap_type)
offset_curve_loose = OffsetCurveLoose(Curve=graft(curve_10), Distance=stream_filter_2)
shift_paths = ShiftPaths(Data=offset_curve, Offset=-1)
stream_filter_3 = StreamFilter(Gate=toggle_between_offset_methods, Stream0=offset_curve_loose, Stream1=shift_paths)

list_item_4 = ListItem(List=reverse(flatten(curve_10)), Index=Slider(0, range=0..10), Wrap=True)

# ----
# Vertical curve repetition and rotation module
# Put your curve here
curve_11 = Curve(list_item_4)

series_3 = Series(Start="0", Step=vertical_spacing_layer_height, Count=quantity_of_repetitions)
bounding_box_2 = BoundingBox(Content=curve_11, Plane=PlaneXY(0, 0, 0))  # -> Box, Box_2
unit_z_5 = UnitZ(Factor=series_3)
volume_2 = Volume(Geometry=bounding_box_2.Box)  # -> Volume, Centroid
move_2 = Move(Geometry=curve_11, Motion=unit_z_5)  # -> graft(Geometry), Transform
series_4 = Series(Start="0", Step=rotation_angle, Count=quantity_of_repetitions)
negative_3 = Negative(Value=walls_spacing)
rotate = Rotate(Geometry=move_2.Geometry, Angle=graft(degrees(series_4)), Plane=volume_2.Centroid)  # -> Geometry, Transform
stream_filter_4 = StreamFilter(Gate=walls_inside_true_outside_false, Stream0=walls_spacing, Stream1=negative_3)
series_5 = Series(Start="0", Step=stream_filter_4, Count=walls_quantity)
offset_curve_2 = OffsetCurve(Curve=rotate.Geometry, Plane=PlaneXY(0, 0, 0), Distance=series_5, BothSides=0, Kinks=0, CapType=1)

# ----
# Walls Curve
curve_12 = Curve(offset_curve_2)

bounding_box_3 = BoundingBox(Content=stream_filter_3, Plane=PlaneXY(0, 0, 0))  # -> Box, Box_2
reverse_list = ReverseList(List=stream_filter_3)
volume_3 = Volume(Geometry=bounding_box_3.Box)  # -> Volume, Centroid
stream_filter_5 = StreamFilter(Gate=inside_wals_or_outside, Stream0=reverse_list, Stream1=stream_filter_3)
# Triming the layers with the walls
scale_2 = Scale(Geometry=stream_filter_3, Center=volume_3.Centroid, Factor=Slider(0.999, range=0..1))  # -> Geometry, Transform
list_item_5 = ListItem(List=scale_2.Geometry, Index="1", Wrap=True)
surface_split = SurfaceSplit(Surface=graft(surface_2), Curves=list_item_5)
list_item_6 = ListItem(List=stream_filter_5, Index="0", Wrap=True)
list_item_7 = ListItem(List=surface_split, Index=Slider(1, range=0..10), Wrap=True)
list_item_8 = ListItem(List=surface_split, Index=Slider(2, range=0..10), Wrap=True)

# ----
# Inner Layer
# Surfaces
surface_menor = Surface(list_item_7)

# ----
# Inner Walls Surface
surface_menor_2 = Surface(surface_menor)

list_length = ListLength(List=flatten(surface_menor_2))
construct_domain = ConstructDomain(DomainStart=0, DomainEnd=list_length)
range = Range(Domain=construct_domain, Steps=expr("x-1", list_length))
bounds_2 = Bounds(Numbers=range)
remap_numbers_2 = RemapNumbers(Value=range, Source=bounds_2, Target="0 to 1")  # -> Mapped, Clipped
graph_mapper_3 = GraphMapper(
    remap_numbers_2.Mapped,
    x0=0,
    x1=1,
    y0=0,
    y1=1,
    Ox=0.5021724701,
    Oy=0.1518112421,
    Px=0.8655811548,
    Py=0.5952891111,
    container_name="Parabola")
multiplication_6 = Multiplication(A="2", B=infill_density)
construct_domain_2 = ConstructDomain(DomainStart=0, DomainEnd=multiplication_6)
round_to_decimal_place = RoundToDecimalPlace(NumberX=graph_mapper_3, DecimalPlace="0,1", RoundType=0)  # -> Rounded, Difference
remap_numbers_3 = RemapNumbers(Value=round_to_decimal_place.Rounded, Source="0 to 1", Target=construct_domain_2)  # -> Mapped, Clipped
integer = Integer(remap_numbers_3.Mapped)

bounding_box_4 = BoundingBox(Content=flatten(surface_menor_2), Plane=PlaneXY(0, 0, 0), UnionBox=True)  # -> Box, Box_2
deconstruct_brep_2 = DeconstructBrep(Brep=bounding_box_4.Box)  # -> Faces, Edges, Vertices
list_item_9 = ListItem(List=deconstruct_brep_2.Faces, Index=Slider(8, range=0..10), Wrap=True)
list_item_10 = ListItem(List=deconstruct_brep_2.Faces, Index=Slider(1, range=0..10), Wrap=True)
list_item_11 = ListItem(List=deconstruct_brep_2.Faces, Index=Slider(9, range=0..10), Wrap=True)
list_item_12 = ListItem(List=deconstruct_brep_2.Faces, Index=Slider(0, range=0..10), Wrap=True)
area = Area(Geometry=list_item_12)  # -> Area, Centroid
area_2 = Area(Geometry=list_item_11)  # -> Area, Centroid
area_3 = Area(Geometry=list_item_10)  # -> Area, Centroid
# Infill Density (Graphmap)
area_4 = Area(Geometry=list_item_9)  # -> Area, Centroid
# Infill lines generation and rotation
line = Line(StartPoint=area_3.Centroid, EndPoint=area_2.Centroid)
line_2 = Line(StartPoint=area.Centroid, EndPoint=area_4.Centroid)
dispatch = Dispatch(List=flatten(integer), DispatchPattern=[True, False])  # -> ListA, ListB
list_length_2 = ListLength(List=dispatch.ListA)
repeat_data = RepeatData(Data=line, Length=list_length_2)
list_length_3 = ListLength(List=dispatch.ListB)
repeat_data_2 = RepeatData(Data=line_2, Length=list_length_3)
shift_paths_2 = ShiftPaths(Data=repeat_data_2, Offset=-1)
volume_4 = Volume(Geometry=bounding_box_4.Box)  # -> Volume, Centroid
divide_curve_3 = DivideCurve(Curve=flatten(repeat_data), Count=flatten(dispatch.ListA), Kinks=False)  # -> Points, Tangents, Parameters
divide_curve_4 = DivideCurve(Curve=flatten(shift_paths_2), Count=flatten(dispatch.ListB), Kinks=False)  # -> Points, Tangents, Parameters
yz_plane = YZPlane(Origin=divide_curve_3.Points)
xz_plane = XZPlane(Origin=divide_curve_4.Points)
rotate_2 = Rotate(Geometry=yz_plane, Angle=degrees(infill_rotation), Plane=volume_4.Centroid)  # -> Geometry, Transform
rotate_3 = Rotate(Geometry=xz_plane, Angle=degrees(infill_rotation), Plane=volume_4.Centroid)  # -> Geometry, Transform
number_slider_3 = Slider(1000, range=0..1000)
dispatch_2 = Dispatch(List=flatten(surface_menor_2), DispatchPattern=[True, False])  # -> graft(ListA), graft(ListB)
circle_2 = Circle(Plane=rotate_2.Geometry, Radius=number_slider_3)
circle_3 = Circle(Plane=rotate_3.Geometry, Radius=number_slider_3)
brep_brep = BrepBrep(BrepA=dispatch_2.ListA, BrepB=circle_2)  # -> Curves, Points
brep_brep_2 = BrepBrep(BrepA=dispatch_2.ListB, BrepB=circle_3)  # -> Curves, Points

# ----
# Walls
paredes = Curve(stream_filter_3)

# ----
# Outer Wall
# Infill Generation Module
paredes_2 = Curve(list_item_6)

shift_paths_3 = ShiftPaths(Data=brep_brep.Curves, Offset=-1)
shift_paths_4 = ShiftPaths(Data=brep_brep_2.Curves, Offset=-1)
dispatch_3 = Dispatch(List=shift_paths_3, DispatchPattern=[True, False])  # -> ListA, ListB
dispatch_4 = Dispatch(List=shift_paths_4, DispatchPattern=[True, False])  # -> ListA, ListB
flip_curve = FlipCurve(Curve=dispatch_4.ListB)  # -> Curve, Flag
flip_curve_2 = FlipCurve(Curve=dispatch_3.ListB)  # -> Curve, Flag
shift_list = ShiftList(List=dispatch_4.ListA, Shift=Slider(0, range=-5..10), Wrap=True)
# Connecting infill lines
shift_list_2 = ShiftList(List=dispatch_3.ListA, Shift=Slider(0, range=-5..10), Wrap=True)
weave = Weave(Pattern=[0, 1], Stream0=shift_list_2, Stream1=flip_curve_2.Curve, NullGaps=False)
weave_2 = Weave(Pattern=[0, 1], Stream0=shift_list, Stream1=flip_curve.Curve, NullGaps=False)
connect_curves = ConnectCurves(Curves=weave_2, Continuity=Slider(0, range=0..10), Close=Slider(0, range=0..10), Bulge=Slider(0, range=0..100))
connect_curves_2 = ConnectCurves(Curves=weave, Continuity=Slider(0, range=0..10), Close=Slider(0, range=0..10), Bulge=Slider(0, range=0..100))
weave_3 = Weave(Pattern=[0, 1], Stream0=connect_curves_2, Stream1=connect_curves, NullGaps=False)  # -> graft(Weave)

# ----
# Infill
infill = Curve(weave_3)

walls = Curve(paredes)

# ----
# Use this to interpolate
# the order of paths you want
# Example: 2 walls 1 infill
weave_4 = Weave(Pattern=[0, 1], Stream0=walls, Stream1=infill, NullGaps=False)

# ----
# Printing path union module
curve_13 = Curve(curve_12)

# ----
# Use this to stack your
# paths in the order of
# printing
merge = Merge(Data1=flatten(weave_4), Data2=flatten(curve_13))

curve_to_polyline = CurveToPolyline(Curve=merge, ToleranceDistance=0, ToleranceAngle=degrees(tolerance))  # -> Polyline, Segments
explode = Explode(Curve=curve_to_polyline.Polyline, Recursive=True)  # -> Segments, Vertices
print_speed_4 = Number(multiplication)
parameters = Data(silkworm_movement_delimiter)
flow_2 = Number(flow)
silkworm_extrusion_path = SilkwormExtrusionPath(MovementLines=explode.Segments, SpeedParameter=print_speed_4, FlowRatio=flow_2, Delimiter=parameters)

# ----
# Path and gcode modules
# Gcode Visualizer
# Change the sliders below so you
# can preview your gcode
silkworm_compiler = SilkwormCompiler(SilkwormMovements=flatten(silkworm_extrusion_path))  # -> GCode, SilkwormModel
silkworm_viewer = SilkwormViewer(
    SilkwormModel=silkworm_compiler.SilkwormModel,
    LayerStart=inicial_layer,
    LayerEnd=final_layer,
    ShowLogistics=show_travels,
    ShowValues=show_gcode_preview)

# ----
# Gcode assembly and export
# Your code:
merge_2 = Merge(Data1=flatten(start_gcode), Data2=flatten(silkworm_compiler.GCode), Data3=flatten(end_gcode))
gcode_preview = Panel(merge_2)
python = FileCreator(name=file_name, lines=gcode_preview, write=export_your_gcode, save_path=path)  # inputs lines: list, write: Boolean
# ---------- python: Python ----------
"""
Creates a file with a given ndame and extension.
    Inputs:
        name: Desired file name.
        lines: Text to write.
        write: Set to True to write.
        save_path: Desired file path.
            Output:
        a: "The a output variable
"""

# Stephen P. Maher /  2015

ghenv.Component.Name = "File Creator"

import os

file_path = os.path.join(save_path, name)


if write:
    file = open(file_path, "w") # Open the file
    for line in lines: # Iterate through lines
        file.write(line + "\n") # Write separate lines
    file.close() # Close the file
# ---------- end python ----------

multiplication_7 = Multiplication(A=graph_mapper, B=amplitude)

# ----
# Horizontal curve deformation module
move_away_from = MoveAwayFrom(Geometry=divide_curve.Points, Emitter=volume.Centroid, Distance=multiplication_7)  # -> Geometry, Transform

nurbs_curve_2 = NurbsCurve(Vertices=move_away_from.Geometry, Degree=3, Periodic=True)  # -> Curve, Length, Domain

# ----
# Top Curve
curve_14 = Curve(nurbs_curve_2.Curve)
